# Grasshopper definition TopologyBrepEdge.gh (Grasshopper 1.0.7)
# plug-ins: Sandbox Topology

# © 2025 by Tobias Schwinn
brep = Brep(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)
brep_2 = Brep(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)
merge = Merge(Data1=brep, Data2=brep_2)
brep_3 = Brep(merge)
edge = Slider(12, range=0..47)
debrep = DeconstructBrep(Brep=brep_3)  # -> simplify(Faces), Edges, Vertices
brep_topo_edge = BrepTopologyEdge(Breps=brep_3)  # -> ListOfEdgeCurves, FaceEdgeStructure, EdgeFaceStructure
tstat = TreeStatistics(Tree=brep_3)  # -> Paths, Length, Count
pcen = PolygonCenter(Polyline=debrep.Faces)  # -> CenterV, CenterE, CenterA
eval = EvaluateLength(Curve=brep_topo_edge.ListOfEdgeCurves, Length=0.5, Normalized=True)  # -> Point, Tangent, Parameter
dpath = DeconstructPath(Branch=tstat.Paths)
crossref = CrossReference(ListA=dpath, ListB=edge, CrossMode=1)  # -> ListA, ListB
merge_2 = Merge(Data1=crossref.ListA, Data2=crossref.ListB)
path = ConstructPath(Indices=merge_2)
points = PointList(Points=pcen.CenterV, Tags=True, Lines=False, Size=20)
points_2 = PointList(Points=eval.Point, Tags=True, Lines=False, Size=15)
branch = TreeBranch(Tree=brep_topo_edge.EdgeFaceStructure, Path=path, MaintainPaths=True)
item = ListItem(List=debrep.Faces, Index=branch, Wrap=True)
item_2 = ListItem(List=brep_topo_edge.ListOfEdgeCurves, Index=edge, Wrap=True)
ef = Panel(branch)
pipe = Pipe(Curve=item_2, Radius=10, Caps=0)
