# Grasshopper definition TopologyBrepEdgeFilter.gh (Grasshopper 1.0.7)
# plug-ins: Sandbox Topology

brep = Brep(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)
brep_2 = Brep(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)
merge = Merge(Data1=brep, Data2=brep_2)
brep_3 = Brep(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)
brep_4 = Brep(flatten(merge))
valency = Slider(1, range=1..2)
brep_topo_edge = BrepTopologyEdge(Breps=brep_4)  # -> ListOfEdgeCurves, FaceEdgeStructure, EdgeFaceStructure
debrep = DeconstructBrep(Brep=brep_4)  # -> Faces, Edges, Vertices
pcen = PolygonCenter(Polyline=debrep.Faces)  # -> CenterV, CenterE
eval = EvaluateLength(Curve=debrep.Edges, Length=0.5, Normalized=True)  # -> Point, Tangent, Parameter
brep_topo_edge_filter = BrepTopologyEdgeFilter(EdgeList=brep_topo_edge.ListOfEdgeCurves, EdgeFaceStructure=brep_topo_edge.EdgeFaceStructure, ValencyFilter=valency)  # -> ListOfEdgeIDs, ListOfEdges
pipe = Pipe(Curve=brep_topo_edge_filter.ListOfEdges, Radius=5, Caps=0)
item = ListItem(List=brep_topo_edge.ListOfEdgeCurves, Index=brep_topo_edge_filter.ListOfEdgeIDs, Wrap=True)
points = PointList(Points=pcen.CenterV, Tags=True, Lines=False, Size=20)
points_2 = PointList(Points=eval.Point, Tags=True, Lines=False, Size=15)
ids = Panel(brep_topo_edge_filter.ListOfEdgeIDs)
