# Grasshopper definition TopologyBrepVertex.gh (Grasshopper 1.0.7)
# plug-ins: Sandbox Topology

# © 2025 by Tobias Schwinn
brep = Brep(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)
brep_2 = Brep(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)
merge = Merge(Data1=brep, Data2=brep_2)
brep_3 = Brep(merge)
vertex = Slider(15, range=0..47)
brep_topo_vertex = BrepTopologyVertex(Brep=brep_3)  # -> ListOfVertices, FaceVertexStructure, VertexFaceStructure
debrep = DeconstructBrep(Brep=brep_3)  # -> Faces, Edges, Vertices
tstat = TreeStatistics(Tree=brep_3)  # -> Paths, Length, Count
pcen = PolygonCenter(Polyline=debrep.Faces)  # -> CenterV, CenterE, CenterA
dpath = DeconstructPath(Branch=tstat.Paths)
crossref = CrossReference(ListA=dpath, ListB=vertex, CrossMode=1)  # -> ListA, ListB
crv = Curve(debrep.Edges)
merge_2 = Merge(Data1=crossref.ListA, Data2=crossref.ListB)
path = ConstructPath(Indices=merge_2)
points = PointList(Points=brep_topo_vertex.ListOfVertices, Tags=True, Lines=False, Size=15)
points_2 = PointList(Points=pcen.CenterV, Tags=True, Lines=False, Size=20)
branch = TreeBranch(Tree=brep_topo_vertex.VertexFaceStructure, Path=path, MaintainPaths=True)
item = ListItem(List=debrep.Faces, Index=branch, Wrap=True)
vf = Panel(branch)
item_2 = ListItem(List=brep_topo_vertex.ListOfVertices, Index=vertex, Wrap=True)
sph = Sphere(Base=item_2, Radius=15)
