# Grasshopper definition TopologyBrepVertexFilter.gh (Grasshopper 1.0.7)
# plug-ins: Sandbox Topology

# © 2013 by Tobias Schwinn
brep = Brep(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)
valency = Slider(3, range=1..6)
debrep = DeconstructBrep(Brep=brep)  # -> Faces, Edges, Vertices

brep_topo_vertex = BrepTopologyVertex(Brep=brep)  # -> FaceVertexStructure, VertexFaceStructure
brep_topo_vertex_filter = BrepTopologyVertexFilter(VertexList=debrep.Vertices, VertexFaceStructure=brep_topo_vertex.VertexFaceStructure, ValencyFilter=valency)  # -> ListOfVertexIDs, ListOfVertices

pcen = PolygonCenter(Polyline=debrep.Faces)  # -> CenterV, CenterE, CenterA
eval = EvaluateLength(Curve=debrep.Edges, Length=0.5, Normalized=True)  # -> Point, Tangent, Parameter
sph = Sphere(Base=brep_topo_vertex_filter.ListOfVertices, Radius=15)
points = PointList(Points=pcen.CenterV, Tags=True, Lines=False, Size=20)
points_2 = PointList(Points=eval.Point, Tags=True, Lines=False, Size=15)
I = Panel(brep_topo_vertex_filter.ListOfVertexIDs)
