# Grasshopper definition TopologyLine.gh (Grasshopper 1.0.7)
# plug-ins: Sandbox Topology

point = Slider(26, range=0..47)
# © 2025 by Tobias Schwinn
line = Line([Line((196.4149286, -236.0513623, 0), (249.2949603, 44.10912772, 0)), Line((249.2949603, 44.10912772, 0), (142.3157124, 128.6884568, 0)), Line((142.3157124, 128.6884568, 0), (110.557747, 112.1528378, 0)), Line((110.557747, 112.1528378, 0), (78.19701287, 46.10594781, 0)), Line((78.19701287, 46.10594781, 0), (142.5102593, -228.4365666, 0)), Line((613.7365464, 529.0708899, 0), (567.0201741, 276.041333, 0))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])
line_topo = LineTopology(ListOfLines=line, Tolerance=0.001)  # -> ListOfPoints, LinePointStructure, PointPointStructure, PointLineStructure, PointLineStructureIndex
eval = EvaluateLength(Curve=line, Length=0.5, Normalized=True)  # -> Point, Tangent, Parameter
branch = TreeBranch(Tree=simplify(line_topo.PointPointStructure), Path=point, MaintainPaths=True)
branch_2 = TreeBranch(Tree=simplify(line_topo.PointLineStructure), Path=point, MaintainPaths=True)
branch_3 = TreeBranch(Tree=simplify(line_topo.PointLineStructureIndex), Path=point, MaintainPaths=True)
points = PointList(Points=eval.Point, Tags=True, Lines=False, Size=7)
points_2 = PointList(Points=line_topo.ListOfPoints, Tags=True, Lines=False, Size=10)
pli = Panel(branch_3)
item = ListItem(List=line, Index=branch_3, Wrap=True)
item_2 = ListItem(List=line_topo.ListOfPoints, Index=branch, Wrap=True)
pp = Panel(branch)

sph = Sphere(Base=item_2, Radius=10)
pipe = Pipe(Curve=item, Radius=2, Caps=0)
