# Grasshopper definition TopologyLineFilter.gh (Grasshopper 1.0.7)
# plug-ins: Sandbox Topology

crv = Curve([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])
# "Select every vertex that is connected to N lines."
# "Select all lines that are connected to N-valent vertices (by vertex)."
# © 2025 by Tobias Schwinn
crv_2 = Curve([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])
flatten = FlattenTree(Tree=crv_2, Path="{0}")
flatten_2 = FlattenTree(Tree=crv, Path="{1}")
merge = Merge(Data1=flatten, Data2=flatten_2)
line = Line(merge)
valency = Slider(3, range=1..6)
eval = EvaluateLength(Curve=line, Length=0.5, Normalized=True)  # -> Point, Tangent, Parameter

linetopoidx = LineTopologyIndex(ListOfLines=line, Tolerance=0.001)  # -> ListOfPoints, ListOfLines, LinePointStructure, PointPointStructure, PointLineStructure
line_point_filter = LineTopologyPointFilter(ListOfPoints=linetopoidx.ListOfPoints, PointPointStructure=linetopoidx.PointPointStructure, ValencyFilter=valency)  # -> ListOfPoints, ListOfPointIDs
line_edge_filter = LineTopologyEdgeFilter(ListOfLines=linetopoidx.ListOfLines, PointLineStructure=linetopoidx.PointLineStructure, ValencyFilter=valency)  # -> ListOfLines, ListOfLineIDs

points = PointList(Points=eval.Point, Tags=True, Lines=False, Size=15)
points_2 = PointList(Points=linetopoidx.ListOfPoints, Tags=True, Lines=False, Size=10)
pshift = ShiftPaths(Data=line_edge_filter.ListOfLines, Offset=-1)
pshift_2 = ShiftPaths(Data=line_edge_filter.ListOfLineIDs, Offset=-1)
tstat = TreeStatistics(Tree=line_edge_filter.ListOfLines)  # -> Paths, Length, Count

# ---- group: All points connected to N lines
sph = Sphere(Base=line_point_filter.ListOfPoints, Radius=15)

# ----
python = GhPythonScript(L=pshift, I=pshift_2)  # -> out, a, b; inputs L: list of Line, I: list
# ---------- python: Python ----------
filtered_num = []
filtered_lines = []
if L:
    for i,line in zip(I, L):
        if not i in filtered_num:
            filtered_num.append(i)
            filtered_lines.append(line)
            
            
a = filtered_lines
b = filtered_num
# ---------- end python ----------
item = ListItem(List=tstat.Paths, Index=Slider(3, range=0..19), Wrap=True)
panel = Panel(line_point_filter.ListOfPointIDs)
branch = TreeBranch(Tree=line_edge_filter.ListOfLines, Path=item, MaintainPaths=True)
branch_2 = TreeBranch(Tree=line_edge_filter.ListOfLineIDs, Path=item, MaintainPaths=True)
pl = Panel(branch_2)

# ---- group: Lines connected to a given N-valent vertex
pipe = Pipe(Curve=branch, Radius=4, Caps=0)

# ---- group: All unique lines connected to N-valent vertices
pipe_2 = Pipe(Curve=python.a, Radius=4, Caps=0)
