# Grasshopper definition TopologyMeshEdge.gh (Grasshopper 1.0.7)
# plug-ins: MeshEdit Components, Weaverbird, Sandbox Topology

# © 2013 by Tobias Schwinn
mesh = Mesh(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)
edge = Slider(27, range=0..47)
face = Slider(27, range=0..47)
mesh_topo_edge = MeshTopologyEdge(Mesh=mesh)  # -> ListOfEdges, FaceFaceStructure, EdgeFaceStructure
wbfacepolys = WeaverbirdsFacePolylines(Mesh=mesh)
explode = MeshExplode(Mesh=mesh, Interpolate=False)
pcen = PolygonCenter(Polyline=wbfacepolys)  # -> CenterV, CenterE, CenterA
eval = EvaluateLength(Curve=mesh_topo_edge.ListOfEdges, Length=0.5, Normalized=True)  # -> Point, Tangent, Parameter
branch = TreeBranch(Tree=mesh_topo_edge.EdgeFaceStructure, Path=edge, MaintainPaths=True)
branch_2 = TreeBranch(Tree=mesh_topo_edge.FaceFaceStructure, Path=face, MaintainPaths=True)
ff = Panel(branch)
item = ListItem(List=explode, Index=face, Wrap=True)
item_2 = ListItem(List=explode, Index=branch_2, Wrap=True)
item_3 = ListItem(List=mesh_topo_edge.ListOfEdges, Index=edge, Wrap=True)
item_4 = ListItem(List=explode, Index=branch, Wrap=True)
points = PointList(Points=eval.Point, Tags=True, Lines=False, Size=12)
points_2 = PointList(Points=pcen.CenterV, Tags=True, Lines=False, Size=20)
pipe = Pipe(Curve=item_3, Radius=5, Caps=0)
