# Grasshopper definition TopologyMeshVertex.gh (Grasshopper 1.0.7)
# plug-ins: MeshEdit Components, Weaverbird, Sandbox Topology

mesh = Mesh(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)
vertex = Slider(11, range=0..47)
mesh_topo_vertex = MeshTopologyVertex(Mesh=mesh)  # -> ListOfMeshVertices, VertexVertexStructure, VertexFaceStructure
# © 2013 by Tobias Schwinn
wbfacepolys = WeaverbirdsFacePolylines(Mesh=mesh)
explode = MeshExplode(Mesh=mesh, Interpolate=False)
pcen = PolygonCenter(Polyline=wbfacepolys)  # -> CenterV, CenterE, CenterA
branch = TreeBranch(Tree=mesh_topo_vertex.VertexVertexStructure, Path=vertex, MaintainPaths=True)
branch_2 = TreeBranch(Tree=mesh_topo_vertex.VertexFaceStructure, Path=vertex, MaintainPaths=True)
vv = Panel(branch_2)
item = ListItem(List=mesh_topo_vertex.ListOfMeshVertices, Index=vertex, Wrap=True)
item_2 = ListItem(List=mesh_topo_vertex.ListOfMeshVertices, Index=branch, Wrap=True)
item_3 = ListItem(List=explode, Index=branch_2, Wrap=True)
points = PointList(Points=pcen.CenterV, Tags=True, Lines=False, Size=15)
points_2 = PointList(Points=mesh_topo_vertex.ListOfMeshVertices, Tags=True, Lines=False, Size=20)
sph = Sphere(Base=item_2, Radius=10)
sph_2 = Sphere(Base=item, Radius=10)
