# Grasshopper definition TopologyMeshVertexFilter.gh (Grasshopper 1.0.7)
# plug-ins: Sandbox Topology, Weaverbird, MeshEdit Components

mesh = Mesh(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)
# "Select every vertex that has N face neighbors."
# © 2025 by Tobias Schwinn
mesh_2 = Mesh(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)
merge = Merge(Data1=mesh_2, Data2=mesh)  # -> graft(Result)
mesh_3 = Mesh(merge)
valency = Slider(3, range=1..7)

mesh_topo_vertex = MeshTopologyVertex(Mesh=mesh_3)  # -> ListOfMeshVertices, VertexVertexStructure, VertexFaceStructure
mesh_topo_vertex_filter = MeshTopologyVertexFilter(
    VertexList=mesh_topo_vertex.ListOfMeshVertices,
    VertexFaceStructure=mesh_topo_vertex.VertexFaceStructure,
    ValencyFilter=valency)  # -> ListOfVertexIDs, ListOfVertices

wbfacepolys = WeaverbirdsFacePolylines(Mesh=mesh_3)
explode = MeshExplode(Mesh=mesh_3, Interpolate=False)
pcen = PolygonCenter(Polyline=wbfacepolys)  # -> CenterV, CenterE, CenterA
item = ListItem(List=mesh_topo_vertex.ListOfMeshVertices, Index=mesh_topo_vertex_filter.ListOfVertexIDs, Wrap=True)
sph = Sphere(Base=mesh_topo_vertex_filter.ListOfVertices, Radius=15)
points = PointList(Points=pcen.CenterV, Tags=True, Lines=False, Size=20)
points_2 = PointList(Points=mesh_topo_vertex.ListOfMeshVertices, Tags=True, Lines=False, Size=15)
V = Panel(mesh_topo_vertex_filter.ListOfVertexIDs)
