# Grasshopper definition TopologyPolyEdge.gh (Grasshopper 1.0.7)
# plug-ins: Sandbox Topology, LunchBox

crv = Curve([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])
crv_2 = Curve([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])
flatten = FlattenTree(Tree=crv_2, Path="{0}")
point = Slider(10, range=0..47)
flatten_2 = FlattenTree(Tree=crv, Path="{1}")
crv_3 = Curve([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])
merge = Merge(Data1=flatten, Data2=flatten_2)
crv_4 = Curve(merge)
concat = Concatenate(FragmentA="0;", FragmentB=point)
poly_edge_topo = PolygonEdgeTopology(PolygonNetwork=crv_4, Tolerance=Slider(0.001, range=0..1))  # -> OrderedListOfEdges, EdgeIndecesOrderedByFaceIndex, FaceIndecesOrderedByEdgeIndex
pcen = PolygonCenter(Polyline=crv_4)  # -> CenterV, CenterE, CenterA
path = DataPath(concat)
eval = EvaluateLength(Curve=poly_edge_topo.OrderedListOfEdges, Length=0.5, Normalized=True)  # -> Point, Tangent, Parameter
branch = TreeBranch(Tree=poly_edge_topo.FaceIndecesOrderedByEdgeIndex, Path=path, MaintainPaths=True)
dpath = DeconstructPath(Branch=path)
points = PointList(Points=pcen.CenterV, Tags=True, Lines=False, Size=20)
item = ListItem(List=dpath, Index=0, Wrap=True)  # -> Item, Item1
item_2 = TreeItem(Tree=crv_4, Path=item.Item, Index=branch, Wrap=True)
item_3 = TreeItem(Tree=poly_edge_topo.OrderedListOfEdges, Path=item.Item, Index=item.Item1, Wrap=True)
points_2 = PointList(Points=eval.Point, Tags=True, Lines=False, Size=15)
pipe = Pipe(Curve=item_3, Radius=10, Caps=0)
patch = PatchSurface(EdgeCurves=graft(item_2), U=5, V=5, Tolerance=0.001)
