# Grasshopper definition TopologyPolyEdgeFilter.gh (Grasshopper 1.0.7)
# plug-ins: Sandbox Topology

# © 2013 by Tobias Schwinn
tolerance = Slider(0.001, range=0.001..1)
valency = Slider(2, range=1..6)
crv = Curve([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])
pcen = PolygonCenter(Polyline=crv)  # -> CenterV, CenterE, CenterA

poly_topo_edge = PolygonTopologyEdge(ListOfPolylines=crv, Tolerance=tolerance)  # -> ListOfEdges, LoopEdgeStructure, EdgeLoopStructure
edge_list = EdgeToplogyFilter(EdgeList=poly_topo_edge.ListOfEdges, EdgeLoopStructure=poly_topo_edge.EdgeLoopStructure, ValencyFilter=valency)  # -> ListOfEdgeIDs, ListOfEdges

eval = EvaluateLength(Curve=poly_topo_edge.ListOfEdges, Length=0.5, Normalized=True)  # -> Point, Tangent, Parameter
points = PointList(Points=pcen.CenterV, Tags=True, Lines=False, Size=20)
pipe = Pipe(Curve=edge_list.ListOfEdges, Radius=5, Caps=0)
points_2 = PointList(Points=eval.Point, Tags=True, Lines=False, Size=15)
ids = Panel(edge_list.ListOfEdgeIDs)
