# Grasshopper definition TopologyPolyPoint.gh (Grasshopper 1.0.7)
# plug-ins: LunchBox, Sandbox Topology

crv = Curve([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])
crv_2 = Curve([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])
flatten = FlattenTree(Tree=crv_2, Path="{0}")
flatten_2 = FlattenTree(Tree=crv, Path="{1}")
point = Slider(6, range=0..47)
merge = Merge(Data1=flatten, Data2=flatten_2)
crv_3 = Curve([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])
tolerance = Slider(0.001, range=0.001..1)
concat = Concatenate(FragmentA="0;", FragmentB=point)
crv_4 = Curve(merge)
pcen = PolygonCenter(Polyline=crv_4)  # -> CenterV, CenterE
topology = PolygonTopology(ListOfPolylines=crv_4, Tolerance=tolerance)  # -> ListOfPoints, LoopPointStructure, PointLoopStructure
path = DataPath(concat)
dpath = DeconstructPath(Branch=path)
branch = TreeBranch(Tree=topology.PointLoopStructure, Path=path, MaintainPaths=True)
points = PointList(Points=pcen.CenterV, Tags=True, Lines=False, Size=20)
points_2 = PointList(Points=topology.ListOfPoints, Tags=True, Lines=False, Size=15)
item = ListItem(List=dpath, Index=0, Wrap=True)  # -> Item, Item1
item_2 = TreeItem(Tree=topology.ListOfPoints, Path=item.Item, Index=item.Item1, Wrap=True)
item_3 = TreeItem(Tree=crv_4, Path=item.Item, Index=branch, Wrap=True)
pl = Panel(branch)
sph = Sphere(Base=item_2, Radius=20)
patch = PatchSurface(EdgeCurves=graft(item_3), U=2, V=2, Tolerance=0.001)
