# Grasshopper definition TopologyPolygon.gh (Grasshopper 1.0.7)
# plug-ins: Sandbox Topology

crv = Curve([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])
crv_2 = Curve([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])
flatten = FlattenTree(Tree=crv_2, Path="{0}")
flatten_2 = FlattenTree(Tree=crv, Path="{1}")
merge = Merge(Data1=flatten, Data2=flatten_2)
poly_topo_edge = PolygonTopologyEdge(ListOfPolylines=merge, Tolerance=0.001)  # -> ListOfEdges, LoopEdgeStructure, EdgeLoopStructure
poly_topo_point = PolygonTopologyPoint(ListOfPolylines=merge, Tolerance=0.001)  # -> ListOfPoints, LoopPointStructure, PointLoopStructure
explode = Explode(Curve=merge, Recursive=True)  # -> Segments, Vertices
poly_topo_point_filter = PolygonTopologyPointFilter(PointList=poly_topo_point.ListOfPoints, PointLoopStructure=poly_topo_point.PointLoopStructure, ValencyFilter=1)  # -> ListOfPointIDs, ListOfPoints
poly_topo_edge_filter = PolygonTopologyEdgeFilter(EdgeList=poly_topo_edge.ListOfEdges, EdgeLoopStructure=poly_topo_edge.EdgeLoopStructure, ValencyFilter=1)  # -> ListOfEdgeIDs, ListOfEdges
pshift = ShiftPaths(Data=explode.Segments, Offset=-1)
line_topo = LineTopology(ListOfLines=pshift, Tolerance=0.001)  # -> ListOfPoints, LinePointStructure, PointPointStructure, PointLineStructure
line_filter = LineTopologyFilter(ListOfPoints=line_topo.ListOfPoints, PointLineStructure=line_topo.PointLineStructure, ValencyFilter=2)  # -> ListOfPoints, LineStructure
